# Grasshopper definition LuciaLeva_OrganicDome.gh (Grasshopper 1.0.7)
# plug-ins: Kangaroo2 Components, Weaverbird

construct_point = ConstructPoint(XCoordinate=0, YCoordinate=0, ZCoordinate=0)
dome_center = GetPoint(construct_point, AtLeast=1, AtMost=1, Realtime=True)
sides_at_base_of_dome_3_10 = GetNumber(Slider(3, range=3..10), AtLeast=1, AtMost=1, Maximum=1.797693135e+308, Minimum=-1.797693135e+308)
dome_top_radius_20_100 = GetNumber(Slider(60, range=20..100), AtLeast=1, AtMost=1, Maximum=1.797693135e+308, Minimum=-1.797693135e+308)
dome_height_30_90 = GetNumber(Slider(30, range=30..90), AtLeast=1, AtMost=1, Maximum=1.797693135e+308, Minimum=-1.797693135e+308)
addition = Addition(A=sides_at_base_of_dome_3_10, B="2")
multiplication = Multiplication(A=dome_height_30_90, B="1.2")
multiplication_2 = Multiplication(A=dome_top_radius_20_100, B=".3")
division = Division(A=dome_height_30_90, B="1.5")
subtraction = Subtraction(A=addition, B="1")
polygon = Polygon(Plane=dome_center, Radius=dome_height_30_90, Segments=sides_at_base_of_dome_3_10, FilletRadius=0)  # -> Polygon, Length
polygon_2 = Polygon(Plane=dome_center, Radius=dome_top_radius_20_100, Segments=addition, FilletRadius=0)  # -> Polygon, Length
polygon_3 = Polygon(Plane=dome_center, Radius=multiplication_2, Segments=subtraction, FilletRadius=0)  # -> Polygon, Length
unit_z = UnitZ(Factor=multiplication)
unit_z_2 = UnitZ(Factor=division)
move = Move(Geometry=polygon_2.Polygon, Motion=unit_z)  # -> Geometry, Transform
move_2 = Move(Geometry=polygon_3.Polygon, Motion=unit_z_2)  # -> Geometry, Transform
explode = Explode(Curve=polygon.Polygon, Recursive=True)  # -> Segments, Vertices
explode_2 = Explode(Curve=move.Geometry, Recursive=True)  # -> Segments, Vertices
explode_3 = Explode(Curve=move_2.Geometry, Recursive=True)  # -> Segments, Vertices
divide_curve = DivideCurve(Curve=explode.Segments, Count="2", Kinks=False)  # -> flatten(Points), Tangents, Parameters
divide_curve_2 = DivideCurve(Curve=explode_2.Segments, Count="2", Kinks=False)  # -> flatten(Points), Tangents, Parameters
divide_curve_3 = DivideCurve(Curve=explode_3.Segments, Count="2", Kinks=False)  # -> flatten(Points), Tangents, Parameters
cull_duplicates = CullDuplicates(Points=divide_curve.Points, Tolerance=0.1, CullMode=3)  # -> Points, Indices, Valence
cull_duplicates_2 = CullDuplicates(Points=divide_curve_2.Points, Tolerance=0.1, CullMode=3)  # -> Points, Indices, Valence
cull_duplicates_3 = CullDuplicates(Points=divide_curve_3.Points, Tolerance=0.1, CullMode=3)  # -> Points, Indices, Valence
nurbs_curve = NurbsCurve(Vertices=cull_duplicates.Points, Degree=3, Periodic=invert(False))  # -> Curve, Length, Domain
nurbs_curve_2 = NurbsCurve(Vertices=cull_duplicates_2.Points, Degree=3, Periodic=invert(False))  # -> Curve, Length, Domain
nurbs_curve_3 = NurbsCurve(Vertices=cull_duplicates_3.Points, Degree=3, Periodic=invert(False))  # -> Curve, Length, Domain
scale = Scale(Geometry=nurbs_curve_3.Curve, Center=dome_center, Factor=".5")  # -> Geometry, Transform
loft_options = LoftOptions(Closed=False, Adjust=False, Rebuild=0, Refit=0, Type="1")
merge = Merge(Data1=nurbs_curve.Curve, Data2=nurbs_curve_2.Curve, Data3=nurbs_curve_3.Curve, Data4=scale.Geometry)
loft = Loft(Curves=merge, Options=loft_options)
mesh_brep = MeshBrep(
    Brep=loft,
    Settings={GridMaxCount=0, GridMinCount=16, JaggedSeams=False, MaxEdgeLength=0, MinEdgeLength=0.0001, MinTolerance=0, Refine=True, RefineAngle=0, RelativeTolerance=0.65, SimplePlanes=True, Tolerance=0})
division_2 = Division(A=dome_height_30_90, B="25")
triremesh = TriRemesh(Geometry=mesh_brep, Length=division_2, Iterations=25)  # -> Triangulation, Dual, Creases
weaverbird_s_picture_frame = WeaverbirdsPictureFrame(MeshPolylines=triremesh.Triangulation, Distance=5, InsetType=0)
weaverbird_s_mesh_thicken = WeaverbirdsMeshThicken(MeshCurves=weaverbird_s_picture_frame, Distance=".1", OffsetType=0)
mesh = Mesh(weaverbird_s_mesh_thicken)
context_bake = ContextBake(Geometry=mesh)
